# Grasshopper definition brick2unity.gh (Grasshopper 1.0.4)

mesh = Mesh(<mesh referenced from the Rhino model>)
mesh_2 = Mesh(<mesh referenced from the Rhino model>)
mesh_3 = Mesh([<mesh referenced from the Rhino model> x25])
# Read me
# 1. Convert each kind of brick geometry into mesh (as prefabs).
# 2. Copy prefabs into corresponding build positions. (Error might occur if directly convert existing bricks into mesh!)
# 3. Find a point at top center of each prefab as drone's grab position. The point should can be generated by python script. (refer to wall_mesh=>center python script)
# 4. Move each prefabs to make their points at (0,0,0)
# 5. connect GH batteries
mesh_4 = Mesh(<mesh referenced from the Rhino model>)
mesh_5 = Mesh([<mesh referenced from the Rhino model> x20])
mesh_6 = Mesh([<mesh referenced from the Rhino model> x105])
merge = Merge(Data1=mesh, Data2=mesh_3)
merge_2 = Merge(Data1=mesh_2, Data2=mesh_5)
merge_3 = Merge(Data1=mesh_4, Data2=mesh_6)
python = GhPythonScript(corner_end_mesh=merge_2)  # -> center; inputs corner_end_mesh: Mesh
# ---------- python: Python ----------
v = corner_end_mesh.Vertices
center = v[7]+v[396]+v[779]
center.X /= 3
center.Y /= 3
center.Z /= 3
# ---------- end python ----------
python_2 = GhPythonScript(corner_root_mesh=merge)  # -> center; inputs corner_root_mesh: Mesh
# ---------- python_2: Python ----------
v = corner_root_mesh.Vertices
center = v[252]+v[514]+v[1033]
center.X /= 3
center.Y /= 3
center.Z /= 3
# ---------- end python_2 ----------
python_3 = GhPythonScript(wall_mesh=merge_3)  # -> center; inputs wall_mesh: Mesh
# ---------- python_3: Python ----------
v = wall_mesh.Vertices
center = v[542]+v[543]+v[768]+v[769]
center.X /= 4
center.Y /= 4
center.Z /= 4
# ---------- end python_3 ----------
split = SplitList(List=python_2, Index=1)  # -> ListA, ListB
split_2 = SplitList(List=python, Index=1)  # -> ListA, ListB
split_3 = SplitList(List=python_3, Index=1)  # -> ListA, ListB
merge_4 = Merge(Data1=mesh_4, Data2=mesh, Data3=mesh_2)
merge_5 = Merge(Data1=split_3.ListA, Data2=split.ListA, Data3=split_2.ListA)
merge_6 = Merge(Data1=mesh_6, Data2=mesh_3, Data3=mesh_5)
merge_7 = Merge(Data1=split_3.ListB, Data2=split.ListB, Data3=split_2.ListB)
panel = Panel("""Brick1
Brick2
Brick3""")
panel_2 = Panel("""common
root
end""")
python_4 = GhPythonScript(
    prefabs=merge_4,
    prefab_pivots=merge_5,
    prefab_tags=panel,
    prefab_types=panel_2,
    blocks=merge_6,
    block_pivots=merge_7,
    max_distance=Slider(0.6, range=0..1))  # -> out_json, translate, rotation; inputs prefabs: list of Mesh, prefab_pivots: list of Point3d, blocks: list of Mesh, block_pivots: list of Point3d
# ---------- python_4: Python ----------
import math
import json

class Block:
    def __init__(self, id, trans, rot, tag, type, parentList = []):
        self.id = id
        self.trans = trans
        self.rot = rot
        self.tag = tag
        self.type = type
        self.parents = parentList

def calcUnityRotY(prefab_mesh, block_mesh):
    p = 1
    v1 = prefab_mesh.Vertices
    v2 = block_mesh.Vertices
    while (v1[p].X - v1[0].X) < 0.001 and (v1[p].Y - v1[0].Y) < 0.001:
        p += 1
    p1x = v1[p].X - v1[0].X
    p1y = v1[p].Y - v1[0].Y
    p2x = v2[p].X - v2[0].X
    p2y = v2[p].Y - v2[0].Y
    calcAngle = lambda x, y: (math.atan2(y, x)+2*math.pi) % (2*math.pi) / math.pi * 180
    a1 = calcAngle(p1x, p1y)
    a2 = calcAngle(p2x, p2y)
    rot = - (a2 - a1)
    if rot <= -180:
        rot += 360
    return rot

memory = dict()
def dist(brick1, brick2):
    if brick2.id < brick1.id:
        brick1, brick2 = brick2, brick1
    if (brick1, brick2) in memory:
        return memory[(brick1, brick2)]
    d = ((brick1.trans[0]-brick2.trans[0])**2+(brick1.trans[1]-brick2.trans[1])**2+(brick1.trans[2]-brick2.trans[2])**2)**0.5
    memory[(brick1, brick2)] = d
    return d

prefab_tags = prefab_tags.split("\r\n")
prefab_types = prefab_types.split("\r\n")
block_list = []
translate = []
rotation = []
wall_bricks = []

for i, block in enumerate(blocks):
    parentList = []
    p = None
    for j, prefab in enumerate(prefabs):
        if len(prefab.Vertices) == len(block.Vertices) and \
           len(prefab.Faces) == len(block.Faces):
            p = j
    if p is None:
        raise Exception()
    trans = block_pivots[i] - prefab_pivots[p]
    trans = [float(trans.X), float(trans.Y), float(trans.Z)]
    translate.append(str(trans)[1:-1])
    rot = calcUnityRotY(prefabs[p], block)
    
    block_list.append(Block(i, trans, rot, prefab_tags[p], prefab_types[p], parentList))

def findHorizontalChildren(brick):
    if brick.type == "end": return
    def filterFunc(b):
        if (b is brick) or (abs(b.trans[2] - brick.trans[2]) > 0.0001):
            return False
        return True
    h_bricks = sorted(filter(filterFunc, block_list), key=lambda b: dist(b, brick))
    h_children = []
    for i in range(2):
        if len(h_bricks) > i and (h_bricks[i].type != "root") and (h_bricks[i].id not in brick.parents):
            h_bricks[i].parents.append(brick.id)
            h_children.append(h_bricks[i])
    if brick.type == "root" \
        and len(h_children) > 1 \
        and h_children[0].type != "end" \
        and h_children[0].id not in h_children[1].parents:
        h_children[1].parents.append(h_children[0].id)
    for child in h_children:
        findHorizontalChildren(child)

def findUpperChildren(brick):
    def filterFunc(b):
        if (b is brick) or (b.trans[2] - brick.trans[2] < 0.0001) or dist(brick, b) > max_distance:
            return False
        return True
    u_bricks = filter(filterFunc, block_list)
    for child in u_bricks:
        child.parents.append(brick.id)

root_blocks = sorted(filter(lambda b: b.type == "root", block_list),key=lambda b: b.trans[2])
for root in root_blocks:
    findHorizontalChildren(root)
for block in block_list:
    findUpperChildren(block)
    
out_json = []
for block in block_list:
    out_json.append({'id':block.id,
                     'parent_ids':block.parents,
                     'transX':str(-block.trans[0]),
                     'transY':str(block.trans[2]),
                     'transZ':str(-block.trans[1]),
                     'rotY':str(block.rot),
                     'tag':block.tag,
                     'type':block.type})

out_json = json.dumps(out_json)
# ---------- end python_4 ----------
points = PointList(Points=python_4.translate, Size=0.05)
vec2pt = Vector2Pt(PointA=Point(0, 0, 0), PointB=python_4.translate, Unitize=False)  # -> Vector, Length
vdisex = VectorDisplayEx(Point=Point(0, 0, 0), Vector=vec2pt.Vector, Colour=RGB(0, 0, 0), Width=2)
panel_3 = Panel(python_4.out_json)
