# Grasshopper definition brick2unity.gh (Grasshopper 1.0.4)

mesh = Mesh(<mesh referenced from the Rhino model>)
mesh_2 = Mesh([<mesh referenced from the Rhino model> x3])
# Read me
# 1. Convert each kind of brick geometry into mesh (as prefabs).
# 2. Copy prefabs into corresponding build positions. (Error might occur if directly convert existing bricks into mesh!)
# 3. Find a point at top center of each prefab as drone's grab position. The point should can be generated by python script. (refer to wall_mesh=>center python script)
# 4. Move each prefabs to make their points at (0,0,0)
# 5. connect GH batteries
mesh_3 = Mesh(<mesh referenced from the Rhino model>)
mesh_4 = Mesh([<mesh referenced from the Rhino model> x9])
merge = Merge(Data1=mesh, Data2=mesh_2)
merge_2 = Merge(Data1=mesh_3, Data2=mesh_4)
python = GhPythonScript(corner_mesh=merge)  # -> center; inputs corner_mesh: Mesh
# ---------- python: Python ----------
v = corner_mesh.Vertices
center = v[123]+v[124]+v[285]+v[286]
center.X /= 4
center.Y /= 4
center.Z /= 4
# ---------- end python ----------
python_2 = GhPythonScript(wall_mesh=merge_2)  # -> center; inputs wall_mesh: Mesh
# ---------- python_2: Python ----------
v = wall_mesh.Vertices
center = v[6]+v[7]+v[155]+v[156]
center.X /= 4
center.Y /= 4
center.Z /= 4
# ---------- end python_2 ----------
split = SplitList(List=python, Index=1)  # -> ListA, ListB
split_2 = SplitList(List=python_2, Index=1)  # -> ListA, ListB
panel = Panel("""Brick1
Brick2""")
merge_3 = Merge(Data1=mesh_3, Data2=mesh)
merge_4 = Merge(Data1=split_2.ListA, Data2=split.ListA)
merge_5 = Merge(Data1=mesh_4, Data2=mesh_2)
merge_6 = Merge(Data1=split_2.ListB, Data2=split.ListB)
python_3 = GhPythonScript(prefabs=merge_3, prefab_pivots=merge_4, prefab_tags=panel, blocks=merge_5, block_pivotss=merge_6)  # -> out_json, translate, rotation; inputs prefabs: list of Mesh, prefab_pivots: list of Point3d, blocks: list of Mesh, block_pivotss: list of Point3d
# ---------- python_3: Python ----------
import math
import json

class Block:
    def __init__(self, trans, rot, tag):
        self.trans = trans
        self.rot = rot
        self.tag = tag

def calcUnityRotY(prefab_mesh, block_mesh):
    p = 1
    v1 = prefab_mesh.Vertices
    v2 = block_mesh.Vertices
    while (v1[p].X - v1[0].X) < 0.001 and (v1[p].Y - v1[0].Y) < 0.001:
        p += 1
    p1x = v1[p].X - v1[0].X
    p1y = v1[p].Y - v1[0].Y
    p2x = v2[p].X - v2[0].X
    p2y = v2[p].Y - v2[0].Y
    calcAngle = lambda x, y: (math.atan2(y, x)+2*math.pi) % (2*math.pi) / math.pi * 180
    a1 = calcAngle(p1x, p1y)
    a2 = calcAngle(p2x, p2y)
    rot = - (a2 - a1)
    if rot <= -180:
        rot += 360
    return rot

prefab_tags = prefab_tags.split("\r\n")
block_list = []
translate = []
rotation = []
print(prefabs[0].Vertices[0])
for i, block in enumerate(blocks):
    p = None
    for j, prefab in enumerate(prefabs):
        if len(prefab.Vertices) == len(block.Vertices) and \
           len(prefab.Faces) == len(block.Faces):
            p = j
    if p is None:
        raise Exception()
#    trans = block.Vertices[0] - prefabs[p].Vertices[0]
    trans = block_pivots[i] - prefab_pivots[p]
    trans = [float(trans.X), float(trans.Y), float(trans.Z)]
    translate.append(str(trans)[1:-1])
    rot = calcUnityRotY(prefabs[p], block)
    block_list.append(Block(trans, rot, prefab_tags[p]))
out_json = []
for block in block_list:
    out_json.append({'transX':str(-block.trans[0]),
                     'transY':str(block.trans[2]),
                     'transZ':str(-block.trans[1]),
                     'rotY':str(block.rot),
                     'tag':block.tag})

out_json = json.dumps(out_json)
# ---------- end python_3 ----------
panel_2 = Panel(python_3.out_json)
vec2pt = Vector2Pt(PointA=Point(0, 0, 0), PointB=python_3.translate, Unitize=False)  # -> Vector, Length
vdisex = VectorDisplayEx(Point=Point(0, 0, 0), Vector=vec2pt.Vector, Colour=RGB(0, 0, 0), Width=2)
